# Grasshopper definition 210701_compas_path_plan.gh (Grasshopper 1.0.7)

number_slider = Slider(17, range=0..44)
panel = Panel("fix 22")
crv = Curve([<curve referenced from the Rhino model> x45])
data = Data(crv)
python = GhPythonScript(n=number_slider)  # -> rob_num; inputs n: Int32
# ---------- python: Python ----------
#Robot Order

order = [
2, #0
1, #1
2, #2
1, #3
2, #4
1, #5
2, #6
1, #7
2, #8
2, #9
1, #10
2, #11
2, #12
1, #13
2, #14
2, #15
1, #16
1, #17
2, #18
1, #19
2, #20
1, #21
2, #22
1, #23
2, #24
1, #25
2, #26
2, #27
1, #28
2, #29
1, #30
2, #31
1, #32
2, #33
1, #34
2, #35
2, #36
2, #37
1, #38
2, #39
1, #40
2, #41
2, #42
1, #43
2, #44
]

rob_num = order[n]
# ---------- end python ----------
panel_2 = Panel(python)

# ---- group: profile
# 1.3125" (33.3mm) section.
# this dist is to corner
panel_3 = Panel("4")
panel_4 = Panel("0.0333375")
division = Division(A=panel_4, B="sqrt(2)")
polygon = Polygon(Plane=PlaneXY(0, 0, 0), Radius=division, Segments=panel_3, FilletRadius=0)  # -> Polygon, Length
rotate = Rotate(Geometry=polygon.Polygon, Angle=degrees("45"), Plane=PlaneXY(0, 0, 0))  # -> Geometry, Transform

# ----
pt = Point([<point referenced from the Rhino model> x16])
sph = Sphere(Base=pt, Radius="0.040")

panel_5 = Panel("approach planes offsets")
num = Number(Slider(0, range=0..1))
num_2 = Number(Slider(0.4, range=0..2))

crv_2 = Curve([<curve referenced from the Rhino model> x45])

num_3 = Number(number_slider)
dom = ConstructDomain(DomainStart="0", DomainEnd=num_3)
range = Range(Domain=dom, Steps=num_3)
item = ListItem(List=data, Index=range, Wrap=True)
panel_6 = Panel("0.040")
len = Length(Curve=item)
midpt = CurveMiddle(Curve=item)
pframes = PerpFrames(Curve=item, Count="1", Align=True)  # -> Frames, Parameters
panel_7 = Panel("0.020")
orient = Orient(Geometry=rotate.Geometry, Source=PlaneXY(0, 0, 0), Target=simplify(pframes.Frames))  # -> Geometry, Transform
python_2 = GhPythonScript(radius=panel_6, offset=panel_7, len=len)  # -> z_factor; inputs len: list
# ---------- python_2: Python ----------
len_reduce = (radius + offset)*2

z_factor = [(l - len_reduce)/l for l in len]
# ---------- end python_2 ----------
pl = PlaneNormal(Origin=midpt, ZAxis=item)
graft = GraftTree(Tree=item, IncludeEmptyLists=True, IncludeNullItems=True)
swp1 = Sweep1(Rail=graft, Sections=orient.Geometry, Miter=1)
scale_nu = ScaleNU(Geometry=simplify(swp1), Plane=simplify(graft(pl)), ScaleX=1, ScaleY=1, ScaleZ=simplify(graft(python_2)))  # -> Geometry, Transform

# ----
# close circle
# far circle
panel_8 = Panel(num)  # disabled
panel_9 = Panel(num_2)  # disabled
panel_10 = Panel("15")  # disabled
item_2 = ListItem(List=data, Index=number_slider, Wrap=True)  # disabled
midpt_2 = CurveMiddle(Curve=item_2)  # disabled
number_slider_2 = Slider(4, range=0..15)  # disabled
circle = CircleCNR(Center=midpt_2, Normal=item_2, Radius=panel_8)  # disabled
circle_2 = CircleCNR(Center=midpt_2, Normal=item_2, Radius=panel_9)  # disabled
divide = DivideCurve(Curve=circle, Count=panel_10, Kinks=False)  # -> Points, Tangents, Parameters; disabled
divide_2 = DivideCurve(Curve=circle_2, Count=panel_10, Kinks=False)  # -> Points, Tangents, Parameters; disabled
pl_2 = ConstructPlane(Origin=divide.Points, XAxis=item_2, YAxis=divide.Tangents)  # disabled
pl_3 = ConstructPlane(Origin=divide_2.Points, XAxis=item_2, YAxis=divide_2.Tangents)  # disabled
num_4 = Number(number_slider_2)  # disabled
num_5 = Number(number_slider_2)  # disabled
item_3 = ListItem(List=pl_2, Index=num_4, Wrap=True)  # disabled
item_4 = ListItem(List=pl_3, Index=num_5, Wrap=True)  # disabled

panel_11 = Panel(panel_4)
panel_12 = Panel(panel_4)
multiplication = Multiplication(A=len, B=python_2)
box = CenterBox(Base=PlaneXY(0, 0, 0), X=expr("x/2", multiplication), Y=expr("x/2", panel_11), Z=expr("x/2", panel_12))

item_5 = ListItem(List=pl, Index=number_slider, Wrap=True)  # disabled
item_6 = ListItem(List=flatten(scale_nu.Geometry), Index=number_slider, Wrap=True)  # disabled
deplane = DeconstructPlane(Plane=item_5)  # -> Origin, XAxis, YAxis, ZAxis; disabled
deplane_2 = DeconstructPlane(Plane=item_3)  # -> Origin, XAxis, YAxis, ZAxis; disabled
xprod = CrossProduct(VectorA=deplane.XAxis, VectorB=deplane_2.ZAxis, Unitize=True)  # -> Vector, Length; disabled
angle = Angle(VectorA=deplane_2.ZAxis, VectorB=deplane.XAxis)  # -> Angle, Reflex; disabled
dprod = DotProduct(VectorA=deplane.XAxis, VectorB=deplane_2.ZAxis, Unitize=True)  # disabled
dprod_2 = DotProduct(VectorA=xprod.Vector, VectorB=deplane.ZAxis, Unitize=False)  # disabled
python_3 = GhPythonScript(dot=dprod, cross_dot=dprod_2, a=angle.Angle)  # -> out, a; disabled
# ---------- python_3: Python ----------
if dot > 0 and cross_dot > 0:
    a = a
elif dot < 0 and cross_dot > 0:
    a = a
elif dot < 0 and cross_dot < 0:
    a = -a
elif dot > 0 and cross_dot < 0:
    a = -a
# ---------- end python_3 ----------
rot3d = Rotate3D(Geometry=item_6, Angle=python_3.a, Center=deplane.Origin, Axis=deplane.ZAxis)  # -> Geometry, Transform; disabled
rotation_angle = Panel(python_3.a)  # disabled
preview = CustomPreview(
    Geometry=rot3d.Geometry,
    Material={diffuse=RGB(221, 160, 221), emission=RGB(66, 48, 66), shine=0.5, specular=RGB(255, 255, 255), transparency=0})  # disabled

addition = Addition(A="0.040", B="0.020")
panel_13 = Panel(len)
multiplication_2 = Multiplication(A=addition, B=2)
subtraction = Subtraction(A=panel_13, B=multiplication_2)
panel_14 = Panel(subtraction)
multiplication_3 = Multiplication(A=panel_14, B=1000)
panel_15 = Panel(multiplication_3)

# ---- group: lacing wobj
pln = Plane()  # disabled
pln_2 = Plane()  # disabled
python_4 = GhPythonScript()  # -> out, t_a; disabled
# ---------- python_4: Python ----------
from compas.geometry import Frame
from compas.geometry import Point
from compas_ghpython import draw_frame
from compas.geometry import Transformation

from compas_rhino.geometry import RhinoPlane


wobj_A = Frame.from_quaternion([0.999987, 0.002274, -0.001300, 0.004463])
wobj_A.point = [2239.98, 1816.570, 150.477]

f_a = RhinoPlane.from_geometry(wobj_A).to_compas() 
print(f_a)

t_a = Transformation.from_frame(f_a)
print t_a
# ---------- end python_4 ----------
python_5 = GhPythonScript(p_send1=pln_2, p_send2=pln, t_a=python_4.t_a)  # -> out, f_send_trans1, f_send_trans2; inputs p_send1: Plane; disabled
# ---------- python_5: Python ----------
from compas.geometry import Frame
from compas.geometry import Point
from compas_ghpython import draw_frame
from compas.geometry import Transformation

from compas_rhino.geometry import RhinoPlane

f_send1 = RhinoPlane.from_geometry(p_send1).to_compas() 
f_send2 = RhinoPlane.from_geometry(p_send2).to_compas() 

p_trans1 = f_send1.transformed(t_a.inverse())
p_trans2 = f_send2.transformed(t_a.inverse())

f_send_trans1 = draw_frame(p_trans1)
f_send_trans2 = draw_frame(p_trans2)
# ---------- end python_5 ----------
pln_3 = Plane(python_5.f_send_trans1)  # disabled
pln_4 = Plane(python_5.f_send_trans2)  # disabled

# ----
panel_16 = Panel("22 is messed up")
panel_17 = Panel("""0
pi
pi/2
-0.20944
-1.884956
2.722714
-0.20944+pi
-1.884956
-1.466077+pi
0.20944 + pi/2
-1.884956
1.884956
1.047198
Pi
-0.20944
-1.884956 - pi/2
-2.722714-0.7
0.20944
2.722714
2.722714
-1.047198
Pi
-1.047198 + pi/2
2.303835
-1.466077
-2.722714
-Pi
-0.20944
-1.466077
-1.884956
Pi
-1.884956
2.303835-PI
-1.884956
-0.20944
0.628319
0.628319
2.303835
1.466077
1.466077
1.884956
1.884956
-0.20944
-1.466077
-1.466077""")
item_7 = ListItem(List=panel_17, Index=range, Wrap=True)

round = Round(Number=panel_15)  # -> Nearest, Floor, Ceiling
panel_18 = Panel(round.Nearest)
mesh = Mesh(box)

panel_19 = Panel(number_slider)
rot3d_2 = Rotate3D(Geometry=simplify(graft(pl)), Angle=simplify(graft(item_7)), Center=simplify(graft(midpt)), Axis=simplify(graft(item)))  # -> Geometry, Transform
rot3d_3 = Rotate3D(
    Geometry=simplify(graft(scale_nu.Geometry)),
    Angle=simplify(graft(item_7)),
    Center=simplify(graft(midpt)),
    Axis=simplify(graft(item)))  # -> Geometry, Transform
item_8 = ListItem(List=flatten(rot3d_2.Geometry), Index=panel_19, Wrap=True)
item_9 = ListItem(List=flatten(rot3d_3.Geometry), Index=panel_19, Wrap=True)
item_10 = ListItem(List=flatten(mesh), Index=panel_19, Wrap=True)

division_2 = Division(A=round.Nearest, B=2)
panel_20 = Panel(division_2)

panel_21 = Panel(num)
panel_22 = Panel(num_2)
deplane_3 = DeconstructPlane(Plane=item_8)  # -> Origin, XAxis, YAxis, ZAxis
multiplication_4 = Multiplication(A=deplane_3.XAxis, B=panel_21)
multiplication_5 = Multiplication(A=deplane_3.XAxis, B=panel_22)
move = Move(Geometry=deplane_3.Origin, Motion=expr("-x", multiplication_4))  # -> Geometry, Transform
move_2 = Move(Geometry=deplane_3.Origin, Motion=expr("-x", multiplication_5))  # -> Geometry, Transform
multiplication_6 = Multiplication(A=move.Geometry, B=1000)
multiplication_7 = Multiplication(A=move_2.Geometry, B=1000)
pl_4 = ConstructPlane(Origin=multiplication_6, XAxis=deplane_3.YAxis, YAxis=deplane_3.ZAxis)
pl_5 = ConstructPlane(Origin=move.Geometry, XAxis=deplane_3.YAxis, YAxis=deplane_3.ZAxis)
pl_6 = ConstructPlane(Origin=multiplication_7, XAxis=deplane_3.YAxis, YAxis=deplane_3.ZAxis)
pl_7 = ConstructPlane(Origin=move_2.Geometry, XAxis=deplane_3.YAxis, YAxis=deplane_3.ZAxis)

mesh_2 = Mesh(flatten(sph))

# ----
# R2 PICKUP PLANES
panel_23 = Panel("3246.00")
Z = UnitZ(Factor="0.450")
vec = VectorXYZ(XComponent="-0.5", YComponent="-0.5", ZComponent="0.450")  # -> Vector, Length
pt_2 = ConstructPoint(XCoordinate=panel_23, YCoordinate="1836.5", ZCoordinate="733.4")
X = UnitX(Factor=1)
Y = UnitY(Factor=1)
division_3 = Division(A=pt_2, B=1000)
multiplication_8 = Multiplication(A=Z, B=1000)
multiplication_9 = Multiplication(A=vec.Vector, B=1000)
pl_8 = ConstructPlane(Origin=division_3, XAxis=expr("-x", X), YAxis=Y)
pl_9 = ConstructPlane(Origin=pt_2, XAxis=expr("-x", X), YAxis=Y)
move_3 = Move(Geometry=pl_9, Motion=multiplication_9)  # -> Geometry, Transform
move_4 = Move(Geometry=pl_9, Motion=multiplication_8)  # -> Geometry, Transform
move_5 = Move(Geometry=pl_8, Motion=vec.Vector)  # -> Geometry, Transform
move_6 = Move(Geometry=pl_8, Motion=Z)  # -> Geometry, Transform
pln_5 = Plane(move_6.Geometry)
pln_6 = Plane(pl_8)
pln_7 = Plane(move_5.Geometry)
pln_8 = Plane(move_4.Geometry)
pln_9 = Plane(pl_9)
pln_10 = Plane(move_3.Geometry)

pln_11 = Plane(pln_7)

# ----
# R1 - PICKUP PLANES
panel_24 = Panel("-0.5")
Z_2 = UnitZ(Factor="0.450")
vec_2 = VectorXYZ(XComponent=panel_24, YComponent="0.5", ZComponent="0.450")  # -> Vector, Length
pt_3 = ConstructPoint(XCoordinate="3246.00", YCoordinate="1838.30", ZCoordinate="729.6")
X_2 = UnitX(Factor=1)
Y_2 = UnitY(Factor=1)
division_4 = Division(A=pt_3, B=1000)
multiplication_10 = Multiplication(A=Z_2, B=1000)
multiplication_11 = Multiplication(A=vec_2.Vector, B=1000)
pl_10 = ConstructPlane(Origin=division_4, XAxis=expr("-x", X_2), YAxis=Y_2)
pl_11 = ConstructPlane(Origin=pt_3, XAxis=expr("-x", X_2), YAxis=Y_2)
move_7 = Move(Geometry=pl_10, Motion=vec_2.Vector)  # -> Geometry, Transform
move_8 = Move(Geometry=pl_11, Motion=multiplication_11)  # -> Geometry, Transform
move_9 = Move(Geometry=pl_10, Motion=Z_2)  # -> Geometry, Transform
move_10 = Move(Geometry=pl_11, Motion=multiplication_10)  # -> Geometry, Transform
pln_12 = Plane(move_7.Geometry)
pln_13 = Plane(move_10.Geometry)
pln_14 = Plane(move_9.Geometry)
pln_15 = Plane(pl_10)
pln_16 = Plane(pl_11)
pln_17 = Plane(move_8.Geometry)

pln_18 = Plane(pln_12)

# ----
# VIZUALIZE
mesh_3 = Mesh(flatten(item_9))
pln_19 = Plane(pl_5)
pln_20 = Plane(pl_7)
pln_21 = Plane(pln_5)
mesh_4 = Mesh(flatten(rot3d_3.Geometry))
pln_22 = Plane(pln_14)
pln_23 = Plane(pln_15)
pln_24 = Plane(pln_6)
merge = Merge(Data1=pln_19, Data2=pln_20)
merge_2 = Merge(Data1=pln_22, Data2=pln_23, Data3=pln_21, Data4=pln_24, Data5=pln_18, Data6=pln_11)
shift = ShiftList(List=mesh_4, Shift=-1, Wrap=False)
preview_2 = CustomPreview(Geometry=mesh_2, Material=ColourSwatch(SwatchColor=RGB(112, 129, 255)))
preview_3 = CustomPreview(Geometry=mesh_3, Material=ColourSwatch(SwatchColor=RGB(4, 0, 255)))
preview_4 = CustomPreview(Geometry=shift, Material=ColourSwatch(SwatchColor=RGB(124, 125, 59)))
preview_5 = CustomPreview(
    Geometry=merge_2,
    Material={diffuse=RGB(0, 238, 255), emission=RGB(0, 71, 76), shine=0.5, specular=RGB(255, 255, 255), transparency=0})
preview_6 = CustomPreview(Geometry=merge, Material=ColourSwatch(SwatchColor=RGB(4, 0, 255)))

rob_num = Number(python)
panel_25 = Panel(rob_num)

python_6 = GhPythonScript()  # -> t_a
# ---------- python_6: Python ----------
from compas.geometry import Frame
from compas.geometry import Point
from compas_ghpython import draw_frame
from compas.geometry import Transformation

from compas_rhino.geometry import RhinoPlane

wobj_A = Frame.from_quaternion([0.999964,0.00426176,-0.00158504,-0.00717332])
wobj_A.point = [-681.039,1564.71,817.284]

f_a = RhinoPlane.from_geometry(wobj_A).to_compas() 
print(f_a)

t_a = Transformation.from_frame(f_a)
print t_a
# ---------- end python_6 ----------

pln_25 = Plane(pln_13)
pln_26 = Plane(pln_16)
pln_27 = Plane(pln_17)
merge_3 = Merge(Data1=pln_25, Data2=pln_26, Data3=pln_27)
python_7 = GhPythonScript(p_send=merge_3, t_a=python_6)  # -> f_send; inputs p_send: list
# ---------- python_7: Python ----------
from compas.geometry import Frame
from compas_ghpython import draw_frame
from compas_rhino.geometry import RhinoPlane
#
f_send = []
for p in p_send:
    f = RhinoPlane.from_geometry(p).to_compas()
    f_trans = f.transformed(t_a.inverse())
    f_send.append(f_trans)
    
print f_send
# ---------- end python_7 ----------

pln_28 = Plane(pln_8)
pln_29 = Plane(pln_9)
pln_30 = Plane(pln_10)
merge_4 = Merge(Data1=pln_28, Data2=pln_29, Data3=pln_30)
python_8 = GhPythonScript(p_send=merge_4, t_a=python_6)  # -> f_send; inputs p_send: list; same code as python_7

pln_31 = Plane(pl_6)
pln_32 = Plane(pl_4)
merge_5 = Merge(Data1=pln_31, Data2=pln_32)
python_9 = GhPythonScript(p_send=merge_5, t_a=python_6)  # -> f_send; inputs p_send: list
# ---------- python_9: Python ----------
from compas.geometry import Frame
from compas_ghpython import draw_frame
from compas_rhino.geometry import RhinoPlane

f_send = []
for p in p_send:
    f = RhinoPlane.from_geometry(p).to_compas()
    f_trans = f.transformed(t_a.inverse())
    f_send.append(f_trans)
    
print f_send
# ---------- end python_9 ----------

# ----
# Robot 1
j1 = Slider(-81.69, range=-180..180)
j2 = Slider(0, range=-90..150)
j3 = Slider(0, range=-180..75)
j4 = Slider(0, range=-400..400)
j5 = Slider(97.15, range=-125..120)
j6 = Slider(183.05, range=-400..400)
track = Slider(0, range=0..4)
data_2 = Data([j1, j2, j3, j4, j5, j6, track])

# ----
# Robot 1
python_10 = GhPythonScript()  # -> out, config
# ---------- python_10: Python ----------
#RETURN CONFIG

#axis 1-6 + track (mm)
config = [
-90.0,
0.0,
0.0,
0.0,
90,
180,
100]
# ---------- end python_10 ----------
python_11 = GhPythonScript()  # -> out, config
# ---------- python_11: Python ----------
#ROBOT 1 CONFIG
#Start path planning from

#axis 1-6 + track (mm)
config = [
-37.57,
-3.24,
8.36,
0.19,
84.45,
0,
100]

#6 = 230
# ---------- end python_11 ----------

# ----
# Robot 2
python_12 = GhPythonScript()  # -> out, config
# ---------- python_12: Python ----------
#ROBOT 1 CONFIG
#Start path planning from

#axis 1-6 + track
config = [
40.55,
16.21,
-13.89,
-0.0,
87.68,
130.55,
3900]

#axis #6 = 130.55
# ---------- end python_12 ----------
python_13 = GhPythonScript()  # -> out, config
# ---------- python_13: Python ----------
#RETURN CONFIG

#axis 1-6 + track
config = [
90.0,
0.0,
0.0,
0.0,
90,
180,
3900]
# ---------- end python_13 ----------

# ----
# Robot 2
j1_2 = Slider(92.58, range=-180..180)
j2_2 = Slider(0, range=-90..150)
j3_2 = Slider(0, range=-180..75)
j4_2 = Slider(0, range=-400..400)
j5_2 = Slider(90, range=-125..120)
j6_2 = Slider(190.17, range=-400..400)
track_2 = Slider(4, range=0..4)
data_3 = Data([j1_2, j2_2, j3_2, j4_2, j5_2, j6_2, track_2])

list = ValueList({"Forward Kinematics": 0, "Inverse Kinematics": 1, "Preset Start Point": 2}, selected="Preset Start Point")

panel_26 = Panel("approach")
panel_27 = Panel("place")
pln_33 = Plane(pl_7)
pln_34 = Plane(pl_5)

# ----
# If axis is included then allow the robot to move along track
toggle = BooleanToggle(True)
ros = ROSConnect(connect=Toggle(True))  # -> ros_client, is_connected; inputs port: Int32, connect: Boolean
#   port ip: The ip address ROS. Defaults to 127.0.0.1.
#   port port: The port of ROS. Defaults to 9090.
#   port connect: If True, connects to ROS. If False, disconnects from ROS. Defaults to False.
#   port ros_client: The ROS client.
#   port is_connected: True if connection established.
# ---------- ros: Python ----------
"""
Connect or disconnect to ROS.

COMPAS FAB v0.19.1
"""
from ghpythonlib.componentbase import executingcomponent as component
from scriptcontext import sticky as st

from compas_fab.backends import RosClient
from compas_fab.ghpython.components import create_id


class ROSConnect(component):
    def RunScript(self, ip, port, connect):
        ros_client = None

        ip = ip or '127.0.0.1'
        port = port or 9090

        key = create_id(self, 'ros_client')
        ros_client = st.get(key, None)

        if ros_client:
            st[key].close()
        if connect:
            st[key] = RosClient(ip, port)
            st[key].run(5)

        ros_client = st.get(key, None)
        is_connected = ros_client.is_connected if ros_client else False
        return (ros_client, is_connected)
# ---------- end ros ----------
data_4 = Data(ros.ros_client)
robot = ROSRobot(ros_client=data_4, load=toggle)  # -> robot; inputs load: Boolean
#   port ros_client: The ROS client.
#   port load: If True, loads the robot from ROS. Defaults to False.
# ---------- robot: Python ----------
"""
Load robot directly from ROS.

COMPAS FAB v0.19.1
"""
from compas_ghpython.artists import RobotModelArtist
from ghpythonlib.componentbase import executingcomponent as component
from scriptcontext import sticky as st

from compas_fab.ghpython.components import create_id


class ROSRobot(component):
    def RunScript(self, ros_client, load):
        key = create_id(self, 'robot')

        if ros_client and ros_client.is_connected and load:
            # Load URDF from ROS
            st[key] = ros_client.load_robot(load_geometry=True, precision='12f')
            st[key].artist = RobotModelArtist(st[key].model)

        robot = st.get(key, None)
        if robot:  # client sometimes need to be restarted, without needing to reload geometry
            robot.client = ros_client
        return robot
# ---------- end robot ----------
list_2 = ValueList({"Robot 1": "robot1", "Robot 2": "robot2", "Robot 1 axis": "robot1_axis", "Robot 2 axis": "robot2_axis", "Robot 1 axis gripper": "robot1_axis_gripper", "Robot 2 axis gripper": "robot2_axis_gripper"}, selected="Robot 1 axis gripper")
list_3 = ValueList({"Robot 1": "robot1", "Robot 2": "robot2", "Robot 1 axis": "robot1_axis", "Robot 2 axis": "robot2_axis", "Robot 1 axis gripper": "robot1_axis_gripper", "Robot 2 axis gripper": "robot2_axis_gripper"}, selected="Robot 2 axis gripper")
list_4 = ValueList({"platform": "ecl_platform", "world": "ecl_zero", "wobj_1": "rob1_acadia_EBIT_01", "wobj_2": "rob2_acadia_EBIT_01"}, selected="wobj_2")
list_5 = ValueList({"platform": "ecl_platform", "world": "ecl_zero", "wobj_1": "rob1_acadia_EBIT_01", "wobj_2": "rob2_acadia_EBIT_01"}, selected="wobj_1")
data_5 = Data(list_2)
data_6 = Data(list_3)
panel_28 = Panel(rob_num)
filter = StreamFilter(Gate=panel_28, Stream1=list_5, Stream2=list_4)
data_7 = Data(robot)

python_14 = GhPythonScript(robot=data_7, reset=Button())  # -> out, a
# ---------- python_14: Python ----------
print robot.info()

print robot.get_configurable_joint_names()
print robot.zero_configuration()
# ---------- end python_14 ----------
panel_29 = Panel(python_14.out)
filter_2 = StreamFilter(Gate=panel_25, Stream1=data_5, Stream2=data_6)
data_8 = Data(filter)

data_9 = Data(filter_2)

# ----
# IK
panel_30 = Panel(rob_num)
pln_35 = Plane(pln_14)
pln_36 = Plane(pln_7)
filter_3 = StreamFilter(Gate=panel_30, Stream1=pln_35, Stream2=pln_36)
use_fk_as_start = BooleanToggle(False)
filter_4 = StreamFilter(Gate=use_fk_as_start)
ik = InverseKinematics(robot=data_7, plane=filter_3, start_configuration=filter_4, group=data_9)  # -> configuration
#   port plane: The plane or frame to calculate the inverse kinematic for.
#   port start_configuration: If passed, calculates the inverse such that the joint positions differ the least from the start_configuration. Defaults to the zero configuration.
#   port group: The planning group used for calculation. Defaults to the robot's main planning group.
#   port configuration: The planning group's configuration.
# ---------- ik: Python ----------
"""
Calculate the robot's inverse kinematic for a given plane.

COMPAS FAB v0.19.1
"""
from ghpythonlib.componentbase import executingcomponent as component

from compas_fab.ghpython.components import coerce_frame


class InverseKinematics(component):
    def RunScript(self, robot, plane, start_configuration, group):
        configuration = None
        if robot and robot.client and robot.client.is_connected and plane:
            frame = coerce_frame(plane)
            configuration = robot.inverse_kinematics(frame, start_configuration, group)
        if start_configuration:
            return start_configuration.merged(configuration)
        else:
            return configuration
# ---------- end ik ----------

# ----
# FK - Preset Values
config = GhPythonScript(robot=data_7, r1=python_10.config, r2=python_13.config)  # -> config; inputs r1: list, r2: list
# ---------- config: Python ----------
import math

config = robot.zero_configuration()

for i in range(6):
    config['r1_joint_{}'.format(i + 1)] = r1[i]
    config['r2_joint_{}'.format(i + 1)] = r2[i]

#mm
config['r1_cart_joint'] = r1[6]
config['r2_cart_joint'] = r2[6]

print config
# ---------- end config ----------
config_2 = GhPythonScript(robot=data_7, r1=python_11.config, r2=python_12.config)  # -> config, config_scaled; inputs r1: list, r2: list
# ---------- config_2: Python ----------
import math

config = robot.zero_configuration()

for i in range(6):
    config['r1_joint_{}'.format(i + 1)] = r1[i]
    config['r2_joint_{}'.format(i + 1)] = r2[i]

#mm
config['r1_cart_joint'] = r1[6]
config['r2_cart_joint'] = r2[6]

print config

#for use in path planning
#radians and meters
config_scaled = robot.zero_configuration()

for i in range(6):
    config_scaled['r1_joint_{}'.format(i + 1)] = math.radians(r1[i])
    config_scaled['r2_joint_{}'.format(i + 1)] = math.radians(r2[i])

#mm --> m
config_scaled['r1_cart_joint'] = r1[6]/1000
config_scaled['r2_cart_joint'] = r2[6]/1000

print config_scaled
# ---------- end config_2 ----------

# ----
# FK
config_3 = GhPythonScript(robot=data_7, r1=data_2, r2=data_3)  # -> config; inputs r1: list, r2: list
# ---------- config_3: Python ----------
import math

config = robot.zero_configuration()

for i in range(6):
    config['r1_joint_{}'.format(i + 1)] = math.radians(r1[i])
    config['r2_joint_{}'.format(i + 1)] = math.radians(r2[i])

config['r1_cart_joint'] = r1[6]
config['r2_cart_joint'] = r2[6]

print config
# ---------- end config_3 ----------
gripper_frames = GhPythonScript(robot=data_7, config=config_3)  # -> out
# ---------- gripper_frames: Python ----------
print repr(robot.forward_kinematics(config, group='robot1_axis_gripper'))
print repr(robot.forward_kinematics(config, group='robot2_axis_gripper'))
# ---------- end gripper_frames ----------
panel_31 = Panel(gripper_frames)

filter_5 = StreamFilter(Gate=list, Stream0=config_3, Stream1=ik, Stream2=config_2.config_scaled)
robot_visualize = RobotVisualize(robot=data_7, configuration=filter_5)  # -> visual, collision, attached_meshes, frames, base_frame, ee_frame; inputs attached_collision_meshes: list, show_visual: Boolean, show_collision: Boolean, show_frames: Boolean, show_base_frame: Boolean, show_end_effector_frame: Boolean, show_acm: Boolean; disabled
#   port group: The planning group used for end-effector and base visualization.
#   port configuration: The robot's full configuration.
#   port attached_collision_meshes: A list of attached collision meshes.
#   port show_visual: Whether or not to show the robot's visual meshes.
#   port show_collision: Whether or not to show the robot's collision meshes.
#   port show_frames: Whether or not to show the robot's joint frames.
#   port show_base_frame: Whether or not to show the robot's base frame.
#   port show_end_effector_frame: Whether or not to show the robot's end-effector frame.
#   port show_acm: Whether or not to show the attached collision meshes (if any).
#   port visual: The robot's visual Rhino meshes (if any).
#   port collision: The robot's collision Rhino meshes (if any).
#   port attached_meshes: The attached collision Rhino meshes (if any).
#   port frames: The robot's joint frames as Rhino planes (if any).
#   port base_frame: The robot's base frame as a Rhino plane (if any).
#   port ee_frame: The robot's end-effector frame as a Rhino plane (if any).
# ---------- robot_visualize: Python ----------
"""
Visualizes the robot.

COMPAS FAB v0.19.1
"""
from compas.geometry import Frame
from compas.geometry import Transformation
from compas_ghpython.artists import FrameArtist
from compas_ghpython.artists import MeshArtist
from ghpythonlib.componentbase import executingcomponent as component


class RobotVisualize(component):
    def RunScript(self, robot, group, configuration, attached_collision_meshes, show_visual, show_collision,
                  show_frames, show_base_frame, show_end_effector_frame, show_acm):

        visual = None
        collision = None
        attached_meshes = None
        frames = None
        base_frame = None
        ee_frame = None

        if robot:
            show_visual = True if show_visual is None else show_visual
            configuration = configuration or robot.zero_configuration()

            robot.update(configuration, visual=show_visual, collision=show_collision)
            compas_frames = robot.transformed_frames(configuration, group)

            if show_visual:
                visual = robot.artist.draw_visual()

            if show_collision:
                collision = robot.artist.draw_collision()

            if show_base_frame:
                base_compas_frame = compas_frames[0]
                artist = FrameArtist(base_compas_frame)
                base_frame = artist.draw()

            if show_end_effector_frame:
                ee_compas_frame = robot.forward_kinematics(configuration, group, options=dict(solver='model'))
                artist = FrameArtist(ee_compas_frame)
                ee_frame = artist.draw()

            if show_frames:
                frames = []
                for compas_frame in compas_frames[1:]:
                    artist = FrameArtist(compas_frame)
                    frame = artist.draw()
                    frames.append(frame)

            if show_acm:
                attached_meshes = []
                for acm in attached_collision_meshes:
                    frame = robot.forward_kinematics(configuration, options=dict(solver='model', link_name=acm.link_name))
                    T = Transformation.from_frame_to_frame(Frame.worldXY(), frame)
                    mesh = acm.collision_mesh.mesh.transformed(T)
                    attached_meshes.append(MeshArtist(mesh).draw())

        return (visual, collision, attached_meshes, frames, base_frame, ee_frame)
# ---------- end robot_visualize ----------

scene = PlanningScene(robot=data_7)  # -> scene
#   port scene: A planning scene.
# ---------- scene: Python ----------
"""
Create a planning scene.

COMPAS FAB v0.19.1
"""
from ghpythonlib.componentbase import executingcomponent as component
from scriptcontext import sticky as st

from compas_fab.ghpython.components import create_id
from compas_fab.robots import PlanningScene


class PlanningSceneComponent(component):
    def RunScript(self, robot):
        key = create_id(self, 'planning_scene')
        if robot:
            st[key] = PlanningScene(robot)
        return st.get(key, None)
# ---------- end scene ----------
mesh_5 = Mesh(item_10)
mesh_6 = Mesh(flatten(rot3d_3.Geometry))
mesh_7 = Mesh(item_10)
shift_2 = ShiftList(List=flatten(mesh_6), Shift=-1, Wrap=False)
mjoin = MeshJoin(Meshes=shift_2)
mesh_8 = Mesh(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)
acm = AttachedCollisionMesh(
    scene=scene,
    mesh=mesh_5,
    identifier="member",
    link_name="r1_tcp",
    touch_links="r1_gripper",
    add=Button(),
    remove=Button())  # -> attached_collision_mesh; inputs mesh: Mesh, touch_links: list, add: Boolean, remove: Boolean
#   port scene: The planning scene.
#   port mesh: A collision mesh.
#   port identifier: The identifier of the collision mesh.
#   port link_name: The robot's link name to attach the mesh to.
#   port touch_links: Names of links that the robot is allowed to touch.
#   port add: If True, adds the collision mesh to the planning scene.
#   port remove: If True, removes the collision mesh from the planning scene.
#   port attached_collision_mesh: A collision mesh that is attached to a robot's link.
# ---------- acm: Python ----------
"""
Add an attached collision mesh to the robot.

COMPAS FAB v0.19.1
"""
from ghpythonlib.componentbase import executingcomponent as component

from compas_rhino.geometry import RhinoMesh
from compas_fab.robots import AttachedCollisionMesh
from compas_fab.robots import CollisionMesh


class AttachedCollisionMeshComponent(component):
    def RunScript(self, scene, mesh, identifier, link_name, touch_links, add, remove):
        attached_collision_mesh = None
        if scene and mesh and identifier and link_name:
            compas_mesh = RhinoMesh.from_geometry(mesh).to_compas()
            collision_mesh = CollisionMesh(compas_mesh, identifier)
            attached_collision_mesh = AttachedCollisionMesh(collision_mesh, link_name, touch_links)
            if add:
                scene.add_attached_collision_mesh(attached_collision_mesh)
            if remove:
                scene.remove_attached_collision_mesh(identifier)
                scene.remove_collision_mesh(identifier)
        return attached_collision_mesh
# ---------- end acm ----------
acm_2 = AttachedCollisionMesh(
    scene=scene,
    mesh=mesh_7,
    identifier="member",
    link_name="r2_tcp",
    touch_links="r2_gripper",
    add=Button(),
    remove=Button())  # -> attached_collision_mesh; inputs mesh: Mesh, touch_links: list, add: Boolean, remove: Boolean; same code as acm
cm = CollisionMesh(scene=scene, mesh=simplify(mjoin), identifier="structure_mesh", add=Button(), remove=Button())  # -> ok; inputs mesh: Mesh, add: Boolean, remove: Boolean
#   port scene: The planning scene.
#   port mesh: A collision mesh.
#   port identifier: The identifier of the collision mesh.
#   port add: If True, adds the collision mesh to the planning scene.
#   port remove: If True, removes the collision mesh from the planning scene.
#   port ok: True if the operation was successfully performed.
# ---------- cm: Python ----------
"""
Add or remove a collision mesh from the planning scene.

COMPAS FAB v0.19.1
"""
from compas_rhino.geometry import RhinoMesh
from ghpythonlib.componentbase import executingcomponent as component

from compas_fab.robots import CollisionMesh


class CollisionMeshComponent(component):
    def RunScript(self, scene, M, name, add, remove):
        ok = False
        if scene and M and name:
            mesh = RhinoMesh.from_geometry(M).to_compas()
            collision_mesh = CollisionMesh(mesh, name)
            if add:
                scene.add_collision_mesh(collision_mesh)
                ok = True
            if remove:
                scene.remove_collision_mesh(name)
                ok = True
        return ok
# ---------- end cm ----------
cm_2 = CollisionMesh(scene=scene, mesh=mesh_8, identifier="base_mesh", add=Button(), remove=Button())  # -> ok; inputs mesh: Mesh, add: Boolean, remove: Boolean; same code as cm
panel_32 = Panel(cm_2)
panel_33 = Panel(cm)

constraints_from_plane = ConstraintsFromPlane(robot=data_7, plane=pln_33, group=data_9)  # -> constraints
#   port plane: The plane or frame from which we create position and orientation constraints.
#   port group: The planning group for which we specify the constraint. Defaults to the robot's main planning group.
#   port tolerance_position: The allowed tolerance to the frame's position (defined in the robot's units). Defaults to 0.001
#   port tolerance_xaxis: The allowed tolerance of the frame's X-axis in degrees.
#   port tolerance_yaxis: The allowed tolerance of the frame's Y-axis in degrees.
#   port tolerance_zaxis: The allowed tolerance of the frame's Z-axis in degrees.
#   port constraints: A list containing a position and an orientation constraint.
# ---------- constraints_from_plane: Python ----------
"""
Create a position and an orientation constraint from a plane calculated for the group's end-effector link.

COMPAS FAB v0.19.1
"""
import math

from ghpythonlib.componentbase import executingcomponent as component

from compas_fab.ghpython.components import coerce_frame


class ConstraintsFromPlane(component):
    def RunScript(self, robot, plane, group, tolerance_position, tolerance_xaxis, tolerance_yaxis, tolerance_zaxis):
        goal_constraints = None
        if robot and plane:
            tolerance_position = tolerance_position or 0.001
            tolerance_xaxis = tolerance_xaxis or 1.
            tolerance_yaxis = tolerance_yaxis or 1.
            tolerance_zaxis = tolerance_zaxis or 1.

            frame = coerce_frame(plane)
            tolerances_axes = [math.radians(tolerance_xaxis), math.radians(tolerance_yaxis), math.radians(tolerance_zaxis)]
            goal_constraints = robot.constraints_from_frame(frame, tolerance_position, tolerances_axes, group)

        return goal_constraints
# ---------- end constraints_from_plane ----------
plan_motion = PlanMotion(robot=data_7, goal_constraints=constraints_from_plane, start_configuration=filter_5, group=data_9, compute=Button())  # -> trajectory; inputs goal_constraints: list, attached_collision_meshes: list of Mesh, path_constraints: list, compute: Boolean
#   port goal_constraints: The goal to be achieved, defined in a set of constraints. Constraints can be very specific, for example defining value domains for each joint, such that the goal configuration is included, or defining a volume in space, to which a specific robot link (e.g. the end-effector) is required to move to.
#   port start_configuration: The robot's full configuration, i.e. values for all configurable joints of the entire robot, at the starting position. Defaults to the all-zero configuration.
#   port group: The planning group used for calculation. Defaults to the robot's main planning group.
#   port attached_collision_meshes: A list of attached collision meshes to be included for planning.
#   port path_constraints: Optional constraints that can be imposed along the solution path. Note that path calculation won't work if the start_configuration violates these constraints. Defaults to None.
#   port planner_id: The name of the algorithm used for path planning. Defaults to 'RRTConnectkConfigDefault'
#   port compute: If True, calculates a trajectory.
#   port trajectory: The calculated trajectory.
# ---------- plan_motion: Python ----------
"""
Calculate a motion path.

COMPAS FAB v0.19.1
"""
from ghpythonlib.componentbase import executingcomponent as component
from scriptcontext import sticky as st

from compas_fab.ghpython.components import create_id


class PlanMotion(component):
    def RunScript(self, robot, goal_constraints, start_configuration, group, attached_collision_meshes, path_constraints, planner_id, compute):

        key = create_id(self, 'trajectory')

        path_constraints = list(path_constraints) if path_constraints else None
        attached_collision_meshes = list(attached_collision_meshes) if attached_collision_meshes else None
        planner_id = str(planner_id) if planner_id else 'RRTConnectkConfigDefault'

        if robot and robot.client and robot.client.is_connected and start_configuration and goal_constraints and compute:
            st[key] = robot.plan_motion(goal_constraints,
                                        start_configuration=start_configuration,
                                        group=group,
                                        options=dict(
                                            attached_collision_meshes=attached_collision_meshes,
                                            path_constraints=path_constraints,
                                            planner_id=planner_id,
                                        ))

        trajectory = st.get(key, None)
        return trajectory
# ---------- end plan_motion ----------
trajectory_visualize = TrajectoryVisualize(robot=data_7, group=data_9, trajectory=plan_motion)  # -> start_configuration, configurations, fraction, time, planes, P, V, A
#   port group: The planning group for which this trajectory was planned.
#   port trajectory: The calculated trajectory.
#   port start_configuration: The start configuration of the trajectory.
#   port configurations: The full configurations along the trajectory.
#   port fraction: Indicates the fraction of requested trajectory that was calculated, e.g. 1 means the full trajectory was found.
#   port time: The time which is needed to execute that trajectory at full speed.
#   port planes: The planes of the robot's end-effector.
#   port P: The positions along the trajectory
#   port V: The velocities along the trajectory
#   port A: The accelerations along the trajectory
# ---------- trajectory_visualize: Python ----------
"""
Visualizes a trajectory.

COMPAS FAB v0.19.1
"""
from compas_ghpython import draw_frame
from compas_ghpython import list_to_ghtree
from ghpythonlib.componentbase import executingcomponent as component


class TrajectoryVisualize(component):
    def RunScript(self, robot, group, trajectory):
        start_configuration = None
        configurations = []
        fraction = 0.
        time = 0.

        planes = []
        positions = []
        velocities = []
        accelerations = []

        if robot and trajectory:
            group = group or robot.main_group_name

            for c in trajectory.points:
                configurations.append(robot.merge_group_with_full_configuration(c, trajectory.start_configuration, group))
                frame = robot.forward_kinematics(c, group, options=dict(solver='model'))
                planes.append(draw_frame(frame))
                positions.append(c.positions)
                velocities.append(c.velocities)
                accelerations.append(c.accelerations)

            start_configuration = trajectory.start_configuration
            fraction = trajectory.fraction
            time = trajectory.time_from_start

        P = list_to_ghtree(list(zip(*positions)))
        V = list_to_ghtree(list(zip(*velocities)))
        A = list_to_ghtree(list(zip(*accelerations)))

        # return outputs if you have them; here I try it for you:
        return (start_configuration, configurations, fraction, time, planes, P, V, A)
# ---------- end trajectory_visualize ----------
item_11 = ListItem(List=trajectory_visualize.configurations, Index=Slider(29, range=0..50), Wrap=False)
robot_visualize_2 = RobotVisualize(robot=data_7, configuration=item_11)  # -> visual, collision, attached_meshes, frames, base_frame, ee_frame; inputs attached_collision_meshes: list, show_visual: Boolean, show_collision: Boolean, show_frames: Boolean, show_base_frame: Boolean, show_end_effector_frame: Boolean, show_acm: Boolean; same code as robot_visualize

panel_34 = Panel("take last path")
item_12 = ListItem(List=item_11, Index="-1", Wrap=True)

constraints_from_plane_2 = ConstraintsFromPlane(robot=data_7, plane=pln_34, group=data_9)  # -> constraints; same code as constraints_from_plane
plan_motion_2 = PlanMotion(robot=data_7, goal_constraints=constraints_from_plane_2, start_configuration=item_12, group=data_9, compute=Button())  # -> trajectory; inputs goal_constraints: list, attached_collision_meshes: list of Mesh, path_constraints: list, compute: Boolean; same code as plan_motion
trajectory_visualize_2 = TrajectoryVisualize(robot=data_7, group=data_9, trajectory=plan_motion_2)  # -> start_configuration, configurations, fraction, time, planes, P, V, A; same code as trajectory_visualize
item_13 = ListItem(List=trajectory_visualize_2.configurations, Index=Slider(0, range=0..50), Wrap=False)
robot_visualize_3 = RobotVisualize(robot=data_7, configuration=item_13)  # -> visual, collision, attached_meshes, frames, base_frame, ee_frame; inputs attached_collision_meshes: list, show_visual: Boolean, show_collision: Boolean, show_frames: Boolean, show_base_frame: Boolean, show_end_effector_frame: Boolean, show_acm: Boolean; disabled; same code as robot_visualize

panel_35 = Panel("C:/Users/Edvard/Documents/GitHub/workshop_princeton_2021/ACADIA/output/")
panel_36 = Panel(number_slider)
python_15 = GhPythonScript(path=panel_35, member_num=panel_36, read_data=Toggle(True))  # -> configs
# ---------- python_15: Python ----------
import os
from compas_fab.utilities import read_data_from_json
from compas_fab.robots import Configuration

if read_data:
    data = read_data_from_json(os.path.join(path, 'member_{}_end.json'.format(member_num)))

    print data['config_1']
    print len(data)

configs = []
for i in range(len(data)):
    configs.append(Configuration.from_data(data['config_{}'.format(i)]))
    
print configs[1]
# ---------- end python_15 ----------
python_16 = GhPythonScript(configs=trajectory_visualize_2.configurations, path=panel_35, member_num=panel_36, save_data=Button())  # inputs configs: list
# ---------- python_16: Python ----------
import os
from compas_fab.utilities import write_data_to_json

configs_combined = {}
if save_data:
    for i,c in enumerate(configs):
        configs_combined['config_{}'.format(i)] = c.to_data()
        #c.to_json(os.path.join(path, 'member_{}/config_{}.json'.format(member_num,i)))

    #print configs_combined
    write_data_to_json(configs_combined, os.path.join(path, 'member_{}_end.json'.format(member_num)))
# ---------- end python_16 ----------
python_17 = GhPythonScript(configs=python_15)  # -> out, r1_place, r2_place; inputs configs: list
# ---------- python_17: Python ----------
import math
import compas_rrc as rrc

#configs = configs
    
r1_place = []
r2_place = []
for c in configs:
    r1_axes = rrc.ExternalAxes(c['r1_cart_joint']*1000)
    r1_joints = rrc.RobotJoints(
        math.degrees(c['r1_joint_1']),
        math.degrees(c['r1_joint_2']),
        math.degrees(c['r1_joint_3']),
        math.degrees(c['r1_joint_4']),
        math.degrees(c['r1_joint_5']),
        math.degrees(c['r1_joint_6']),
    )
    
    r2_axes = rrc.ExternalAxes(c['r2_cart_joint']*1000)
    r2_joints = rrc.RobotJoints(
        math.degrees(c['r2_joint_1']),
        math.degrees(c['r2_joint_2']),
        math.degrees(c['r2_joint_3']),
        math.degrees(c['r2_joint_4']),
        math.degrees(c['r2_joint_5']),
        math.degrees(c['r2_joint_6']),
    )
    
    r1_place.append([r1_axes, r1_joints])
    r2_place.append([r2_axes, r2_joints])
# ---------- end python_17 ----------
data_10 = Data(python_17.r1_place)
data_11 = Data(python_17.r2_place)

panel_37 = Panel("C:/Users/Edvard/Documents/GitHub/workshop_princeton_2021/ACADIA/output/")
panel_38 = Panel(number_slider)
python_18 = GhPythonScript(path=panel_37, member_num=panel_38, read_data=Toggle(True))  # -> configs
# ---------- python_18: Python ----------
import os
from compas_fab.utilities import read_data_from_json
from compas_fab.robots import Configuration

if read_data:
    data = read_data_from_json(os.path.join(path, 'member_{}_start.json'.format(member_num)))

    print data['config_1']
    print len(data)

configs = []
for i in range(len(data)):
    configs.append(Configuration.from_data(data['config_{}'.format(i)]))
    
print configs[0]['r1_joint_6']
# ---------- end python_18 ----------
python_19 = GhPythonScript(configs=trajectory_visualize.configurations, path=panel_37, member_num=panel_38, save_data=Button())  # inputs configs: list
# ---------- python_19: Python ----------
import os
from compas_fab.utilities import write_data_to_json

configs_combined = {}
if save_data:
    for i,c in enumerate(configs):
        configs_combined['config_{}'.format(i)] = c.to_data()
        #c.to_json(os.path.join(path, 'member_{}/config_{}.json'.format(member_num,i)))

    print configs_combined
    write_data_to_json(configs_combined, os.path.join(path, 'member_{}_start.json'.format(member_num)))
# ---------- end python_19 ----------
python_20 = GhPythonScript(configs=python_18)  # -> out, r1_place, r2_place; inputs configs: list; same code as python_17
data_12 = Data(python_20.r1_place)
data_13 = Data(python_20.r2_place)

data_14 = Data(data_4)
panel_39 = Panel(rob_num)
panel_40 = Panel(data_8)
data_15 = Data(config)
data_16 = Data(python_7)
data_17 = Data(python_8)
data_18 = Data(config_2.config)
data_19 = Data(data_12)
data_20 = Data(data_13)
data_21 = Data(data_10)
data_22 = Data(data_11)
data_23 = Data(python_9)
python_21 = GhPythonScript(
    ros=data_14,
    rob_num=panel_39,
    wobj=panel_40,
    return_config=data_15,
    send_return=Button(),
    r1_pick_path=data_16,
    r2_pick_path=data_17,
    pick_config=data_18,
    send_pick=Button(),
    r1_place_startpath=data_19,
    r2_place_startpath=data_20,
    send_place_start=Button(),
    r1_place_endpath=data_21,
    r2_place_endpath=data_22,
    send_place_end=Button(),
    place=data_23,
    send_place=Button(),
    get_info=Toggle(False))  # -> out, current_joints; inputs rob_num: Int32, r1_pick_path: list, r2_pick_path: list, r1_place_startpath: list, r2_place_startpath: list, r1_place_endpath: list, r2_place_endpath: list, place: list
# ---------- python_21: Python ----------
import compas_rrc as rrc
from compas.geometry import Frame
from compas.geometry import Plane

from compas_rhino.geometry import RhinoPlane

# Create ABB Client (rob2 = right, rob1 = left)
if rob_num == 1:
    abb = rrc.AbbClient(ros, '/rob1')
    abb.send(rrc.SetTool('ecl_pneumatic_gripper'))
    DO = 'do_1'
    pick_path = r1_pick_path
    path_place_s = r1_place_startpath
    path_place_e = r1_place_endpath
    #pick_track = 100
    
    print('Connected.')
elif rob_num == 2:
    abb = rrc.AbbClient(ros, '/rob2')
    abb.send(rrc.SetTool('ecl_pneumatic_gripper'))
    DO = 'do_2'
    pick_path = r2_pick_path
    path_place_s = r2_place_startpath
    path_place_e = r2_place_endpath
    #pick_track = 3888.11
    
    print('Connected.')

# Define speeds
speed = 100

# set wobj
abb.send(rrc.SetWorkObject(wobj))

if get_info:
    current_joints = abb.send_and_wait(rrc.GetJoints(),  timeout = 3)
    print current_joints
    

if send_return:
    
    if rob_num == 1:
        axis = rrc.ExternalAxes(return_config['r1_cart_joint'])
        joints = rrc.RobotJoints(
            return_config['r1_joint_1'],
            return_config['r1_joint_2'],
            return_config['r1_joint_3'],
            return_config['r1_joint_4'],
            return_config['r1_joint_5'],
            return_config['r1_joint_6'],
        )
    elif rob_num == 2:
        axis = rrc.ExternalAxes(return_config['r2_cart_joint'])
        joints = rrc.RobotJoints(
            return_config['r2_joint_1'],
            return_config['r2_joint_2'],
            return_config['r2_joint_3'],
            return_config['r2_joint_4'],
            return_config['r2_joint_5'],
            return_config['r2_joint_6'],
        )
        
    done = abb.send(rrc.MoveToJoints(joints, axis, speed, rrc.Zone.FINE))
    print('Finished')


if send_pick:
    #open gripper
    done = abb.send_and_wait(rrc.SetDigital(DO,0), timeout = 10)
    
    done = abb.send_and_wait(rrc.MoveToFrame(pick_path[0], speed, rrc.Zone.FINE), timeout = 30)
    future = abb.send(rrc.Stop(feedback_level=rrc.FeedbackLevel.DONE))
    
    done = abb.send_and_wait(rrc.MoveToFrame(pick_path[1], speed, rrc.Zone.FINE), timeout = 30)
    future = abb.send(rrc.Stop(feedback_level=rrc.FeedbackLevel.DONE))
        
    #close gripper
    done = abb.send_and_wait(rrc.SetDigital(DO,1), timeout = 10)
    
    #back to start frame
    done = abb.send_and_wait(rrc.MoveToFrame(pick_path[0], speed, rrc.Zone.FINE), timeout = 10)
    future = abb.send(rrc.Stop(feedback_level=rrc.FeedbackLevel.DONE))
    
#    ext_axes = rrc.ExternalAxes(pick_track)
#    done = abb.send_and_wait(rrc.MoveToRobtarget(pick_path[2],ext_axes,speed, rrc.Zone.FINE), timeout = 30)
#    future = abb.send(rrc.Stop(feedback_level=rrc.FeedbackLevel.DONE))
    
    #Final hard-coded config, path planning starts from here
    if rob_num == 1:
        axis = rrc.ExternalAxes(pick_config['r1_cart_joint'])
        joints = rrc.RobotJoints(
            pick_config['r1_joint_1'],
            pick_config['r1_joint_2'],
            pick_config['r1_joint_3'],
            pick_config['r1_joint_4'],
            pick_config['r1_joint_5'],
            pick_config['r1_joint_6'],
        )
    elif rob_num == 2:
        axis = rrc.ExternalAxes(pick_config['r2_cart_joint'])
        joints = rrc.RobotJoints(
            pick_config['r2_joint_1'],
            pick_config['r2_joint_2'],
            pick_config['r2_joint_3'],
            pick_config['r2_joint_4'],
            pick_config['r2_joint_5'],
            pick_config['r2_joint_6'],
        )
        
    done = abb.send(rrc.MoveToJoints(joints, axis, speed, rrc.Zone.FINE))
    print('Finished')
    
    
if send_place:
    
    for f in place:
        done = abb.send_and_wait(rrc.MoveToFrame(f, speed, rrc.Zone.FINE), timeout = 30)
        future = abb.send(rrc.Stop(feedback_level=rrc.FeedbackLevel.DONE))
        
    print('Finished')
    
    
if send_place_start:
    
    # execute planned path
    # formatted as RobotJoints and ExternalAxes object 
    for axis,joints in path_place_s:
        print axis, joints
        done = abb.send(rrc.MoveToJoints(joints, axis, speed, rrc.Zone.FINE))
        #future = abb.send(rrc.Stop(feedback_level=rrc.FeedbackLevel.DONE)) 

    print('Finished')

if send_place_end:
    
    # execute planned path
    # formatted as RobotJoints and ExternalAxes object 
    for axis,joints in path_place_e:
        print axis, joints
        done = abb.send(rrc.MoveToJoints(joints, axis, speed, rrc.Zone.FINE))
        #future = abb.send(rrc.Stop(feedback_level=rrc.FeedbackLevel.DONE)) 

    print('Finished')
# ---------- end python_21 ----------

panel_41 = Panel(python_21.out)
panel_42 = Panel(python_21.current_joints)
panel_43 = Panel(python_15)
panel_44 = Panel(python_18)
