# Grasshopper definition ACADIA_analysis.gh (Grasshopper 1.0.7)
# plug-ins: karambaGH

# INPUT GEOMETRY
crv = Curve([<curve referenced from the Rhino model> x45])

# ---- group: members
number_slider = Slider(44, range=0..44)
python = GhPythonScript(n=number_slider)  # -> rob_num; inputs n: Int32
# ---------- python: Python ----------
#Robot Order

order = [
2, #0
1, #1
2, #2
1, #3
2, #4
1, #5
2, #6
1, #7
2, #8
2, #9
1, #10
2, #11
2, #12
1, #13
2, #14
2, #15
1, #16
1, #17
2, #18
1, #19
2, #20
1, #21
2, #22
2, #23
2, #24
1, #25
2, #26
1, #27
2, #29
2, #28
1, #30
2, #31
1, #32
1, #33
1, #34
2, #33
2, #38
1, #36
1, #37
#done
2, #36
2, #37
2, #39
2, #41
2, #42
1, #43
]

rob_num = order[n]
# ---------- end python ----------
python_2 = GhPythonScript(n=number_slider)  # -> idx; inputs n: Int32
# ---------- python_2: Python ----------
idx = range(n+1)

print idx
# ---------- end python_2 ----------
panel = Panel(number_slider)
panel_2 = Panel(python)
data = Data(crv)
data_2 = Data(python_2)

# ---- group: nodes
pt = Point([<point referenced from the Rhino model> x17])
python_3 = GhPythonScript(n=number_slider)  # -> idx; inputs n: Int32
# ---------- python_3: Python ----------
sphere_order = {
0: 2,
1: 3,
2: 4,
3: 4,
4: 4,
5: 4,
6: 5,
7: 5,
8: 5,
9: 6,
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}

idx = range(sphere_order[n])

print idx
# ---------- end python_3 ----------
data_3 = Data(pt)
data_4 = Data(python_3)

# ----
num = Number()

# ----
# INPUT PARAMETERS
# can update placement plane location manually during path planning or use default "place_far" value
panel_3 = Panel("C:/Users/Edvard/Documents/GitHub/workshop_princeton_2021/ACADIA/input_data/")
panel_4 = Panel("C:/Users/Edvard/Documents/GitHub/workshop_princeton_2021/ACADIA/input_data/")
python_4 = GhPythonScript(path=panel_4, filename="member_rotations.json", read_data=Toggle(True))  # -> rotations
# ---------- python_4: Python ----------
import os
from compas_fab.utilities import read_data_from_json
from compas_fab.robots import Configuration

if read_data:
    data = read_data_from_json(os.path.join(path, filename))
    
    
print len(data)
print data
print data['member_29']

rotations = []
for i in range(len(data)):
    rotations.append(data['member_{}'.format(i)])

print rotations
# ---------- end python_4 ----------
python_5 = GhPythonScript(path=panel_3, filename="input_params.json", read_data=Toggle(True))  # -> node_diameter, member_offset, cross_section, place_close, place_far
# ---------- python_5: Python ----------
import os
from compas_fab.utilities import read_data_from_json

if read_data:
    data = read_data_from_json(os.path.join(path, filename))

print data

node_diameter = data['node_diameter']
member_offset = data['member_dist_from_node']
cross_section = data['cross_section_dim']
place_far = data['offset_place_far']
place_close = data['offset_place_close']
# ---------- end python_5 ----------
num_2 = Number(python_5.node_diameter)
num_3 = Number(python_5.member_offset)
num_4 = Number(python_5.cross_section)
num_5 = Number(python_5.place_close)
data_5 = Data(python_4)
num_6 = Number(num)

# ---- group: cross-section
# 1 3/16" (30.16mm) section.
# this dist is to corner
panel_5 = Panel(num_4)
division = Division(A=panel_5, B="sqrt(2)")
polygon = Polygon(Plane=PlaneXY(0, 0, 0), Radius=division, Segments="4", FilletRadius=0)  # -> Polygon, Length
rotate = Rotate(Geometry=polygon.Polygon, Angle=degrees("45"), Plane=PlaneXY(0, 0, 0))  # -> Geometry, Transform
# DEFINE KARAMBA ELEMENTS
crv_2 = Curve(rotate.Geometry)

# ----
num_7 = Number(python_5.place_far)

division_2 = Division(A="1050", B="3")
matprops = MaterialPropertiesKaramba3D(
    FamilyOfMaterial="wood",
    Name="poplar",
    YoungsModulus_kN_cm2="1050",
    InPlaneShearModulus_kN_cm2=division_2,
    TransverseShearModulus_kN_cm2=division_2,
    SpecificWeight_kN_m3="6",
    CoefficientOfThermalExpansion_1_C=1e-05,
    YieldStrength_kN_cm2=23.5,
    mode="Isotrop")
num_8 = Number(panel_5)
multiplication = Multiplication(A=num_8, B=100)
material = MaterialKaramba3D(matprops)
number = Number(multiplication)
number_2 = Number(multiplication)
cross_section = CrossSectionKaramba3D(
    FamilyNameOfCrossSection="DefaultCroSec",
    Material=material,
    Height_cm=number,
    UpperFlangeWidth_cm=number_2,
    LowerFlangeWidth_cm=number_2,
    mode="Trapezoid")
crosec = CrossSectionKaramba3D(cross_section)

# ---- group: current member curves
data_6 = Data(data_2)
data_7 = Data(data)
item = ListItem(List=data_7, Index=data_6, Wrap=True)
crv_3 = Curve(item)

# ---- group: member info
len = Length(Curve=crv_3)
midpt = CurveMiddle(Curve=crv_3)
panel_6 = Panel(num_3)
panel_7 = Panel(num_2)
pl = PlaneNormal(Origin=midpt, ZAxis=crv_3)
python_6 = GhPythonScript(radius=panel_7, offset=panel_6, len=len)  # -> z_factor; inputs len: list
# ---------- python_6: Python ----------
len_reduce = (radius + offset)*2

z_factor = [(l - len_reduce)/l for l in len]
# ---------- end python_6 ----------

# ---- group: member meshes
pframes = PerpFrames(Curve=crv_3, Count=1, Align=True)  # -> Frames, Parameters
crv_4 = Curve(crv_2)
orient = Orient(Geometry=crv_4, Source=PlaneXY(0, 0, 0), Target=simplify(pframes.Frames))  # -> Geometry, Transform
swp1 = Sweep1(Rail=graft(crv_3), Sections=orient.Geometry, Miter=1)

# ---- group: member rotations about axis
data_8 = Data(data_5)
data_9 = Data(data_2)
item_2 = ListItem(List=data_8, Index=data_9, Wrap=True)
panel_8 = Panel(item_2)

# ---- group: nodes
data_10 = Data(data_3)
data_11 = Data(data_4)
panel_9 = Panel(num_2)
item_3 = ListItem(List=data_10, Index=data_11, Wrap=True)
sph = Sphere(Base=item_3, Radius=panel_9)

# ----
# split into supportmembers (fixed at base) and normal members (pinned both ends)
python_7 = GhPythonScript()  # -> ele_sup_start, ele_norm, ele_sup_end
# ---------- python_7: Python ----------
ele_sup_start = []
for i in range(3):
    ele_sup_start.append("{}_sup_1".format(i))
    ele_sup_start.append("{}_sup_2".format(i))
    
ele_sup_end = []
for i in range(42,45):
    ele_sup_end.append("{}_sup_1".format(i))
    ele_sup_end.append("{}_sup_2".format(i))
    

#ele_norm = []
#for i in range(3,42):
#    ele_norm.append("{}_norm".format(i))
    
ele_norm = []
for i in range(3,42):
    ele_norm.append("{}_norm_1".format(i))
    ele_norm.append("{}_norm_2".format(i))
    
print ele_norm
# ---------- end python_7 ----------
crv_5 = Curve(crv)
panel_10 = Panel("""3
39
3""")
partition = PartitionList(List=crv_5, Size=panel_10)  # -> simplify(Chunks)
bang = ExplodeTree(Data=partition)  # -> Branch0, Branch1, Branch2
txt = Text(python_7.ele_sup_start)
txt_2 = Text(python_7.ele_norm)
txt_3 = Text(python_7.ele_sup_end)
crv_6 = Curve(bang.Branch0)
crv_7 = Curve(bang.Branch1)
crv_8 = Curve(bang.Branch2)

# ----
# STRUCTURE AT CURRENT STAGE OF CONSTRUCTION
pln = Plane(pl)
pt_2 = Point(midpt)

pt_3 = Point(pt)
item_4 = ListItem(List=pt_3, Index=0, Wrap=True)  # -> Item1, Item
pt_4 = Point(item_4.Item)
pt_5 = Point(item_4.Item1)
supp = SupportKaramba3D(PosInd=pt_4, menu=[buttons(on, on, on, on, on, on)])
supp_2 = SupportKaramba3D(PosInd=pt_5, menu=[buttons(on, on, on, on, on, on)])
support = SupportKaramba3D(supp)
support_2 = SupportKaramba3D(supp_2)

divide = DivideCurve(Curve=crv_6, Count=2, Kinks=False)  # -> Points, Tangents, Parameters
shatter = Shatter(Curve=graft(crv_6), Parameters=divide.Parameters)
crv_9 = Curve(shatter)
txt_4 = Text(txt)
graft = GraftTree(Tree=crv_9, IncludeEmptyLists=True, IncludeNullItems=True)
graft_2 = GraftTree(Tree=txt_4, IncludeEmptyLists=True, IncludeNullItems=True)
crosec_2 = CrossSectionKaramba3D(crosec)
linetobeam = LineToBeamKaramba3D(
    Line=graft,
    Identifier=graft_2,
    CrossSection=crosec_2,
    New=True,
    Remove=True,
    LimitDistance_m=0.005,
    Bending=Toggle(True))  # -> simplify(Element), Points, Info
element = ElementKaramba3D(linetobeam.Element)

divide_2 = DivideCurve(Curve=crv_7, Count=2, Kinks=False)  # -> Points, Tangents, Parameters
shatter_2 = Shatter(Curve=graft(crv_7), Parameters=divide_2.Parameters)
crv_10 = Curve(shatter_2)
txt_5 = Text(txt_2)
graft_3 = GraftTree(Tree=crv_10, IncludeEmptyLists=True, IncludeNullItems=True)
graft_4 = GraftTree(Tree=txt_5, IncludeEmptyLists=True, IncludeNullItems=True)
crosec_3 = CrossSectionKaramba3D(crosec)
linetobeam_2 = LineToBeamKaramba3D(
    Line=graft_3,
    Identifier=graft_4,
    CrossSection=crosec_3,
    New=True,
    Remove=True,
    LimitDistance_m=0.005,
    Bending=Toggle(True))  # -> simplify(Element), Points, Info
element_2 = ElementKaramba3D(linetobeam_2.Element)

divide_3 = DivideCurve(Curve=crv_8, Count=2, Kinks=False)  # -> Points, Tangents, Parameters
shatter_3 = Shatter(Curve=graft(crv_8), Parameters=divide_3.Parameters)
crv_11 = Curve(shatter_3)
txt_6 = Text(txt_3)
graft_5 = GraftTree(Tree=crv_11, IncludeEmptyLists=True, IncludeNullItems=True)
graft_6 = GraftTree(Tree=txt_6, IncludeEmptyLists=True, IncludeNullItems=True)
crosec_4 = CrossSectionKaramba3D(crosec)
linetobeam_3 = LineToBeamKaramba3D(
    Line=graft_5,
    Identifier=graft_6,
    CrossSection=crosec_4,
    New=True,
    Remove=True,
    LimitDistance_m=0.005,
    Bending=Toggle(True))  # -> simplify(Element), Points, Info
element_3 = ElementKaramba3D(linetobeam_3.Element)

Z = UnitZ(Factor="-0.01")
pt_6 = Point(pt)
loads = LoadsKaramba3D(Vector=Vector(0, 0, -1), LCase=0, mode="Gravity")
loads_2 = LoadsKaramba3D(ForceVector=Z, Local=False, PosInd=pt_6, LCase=0, mode="Point")
load = LoadKaramba3D(loads)
load_2 = LoadKaramba3D(loads_2)

# ----
# ELEMENTS
# use poplar wood as the material
entwine = Entwine(Branch00=element, Branch01=element_2, Branch02=element_3, FlattenInputs=True)
element_4 = ElementKaramba3D(simplify(flatten(entwine)))

# ----
# LOADS
# self-weight for all members, with an additional 1kg point load at each support to represent the weight of the nodes. Need to weigh this later.
merge = Merge(Data1=load, Data2=load_2)
load_3 = LoadKaramba3D(merge)

lng = ListLength(List=load_3)
lng_2 = ListLength(List=element_4)
subtraction = Subtraction(A=lng, B="4")
split = SplitList(List=load_3, Index=subtraction)  # -> ListA, ListB
subtraction_2 = Subtraction(A=lng_2, B="24")
split_2 = SplitList(List=element_4, Index=subtraction_2)  # -> ListA, ListB

panel_11 = Panel("""31
30
30
24
24
24
24
31""")
panel_12 = Panel("""28
26
25
22
23
21""")
python_8 = GhPythonScript(n=Slider(0, range=-1..5), remove_eles=panel_12, support_eles=panel_11)  # -> remove_ids, support_idx; inputs n: Int32, remove_eles: list, support_eles: list of Int32
# ---------- python_8: Python ----------
remove_eles_copy = remove_eles[0:n+1]
print remove_eles_copy

remove_eles = []
for remove_ele in remove_eles_copy:
    list = remove_ele.split(',')
    for item in list:
        remove_eles.append(int(item))

print remove_eles
remove_ids = []
for num in remove_eles:
    remove_ids.append("{}_norm_1".format(num))
    remove_ids.append("{}_norm_2".format(num))

print remove_ids

# subtract 3 based on list of nodes, since fixed nodes not part of list
support_idx = support_eles[n] - 3
# ---------- end python_8 ----------
panel_13 = Panel(python_8.remove_ids)
txt_7 = Text(python_8.remove_ids)
python_9 = GhPythonScript(remove_ids=txt_7)  # -> remove_index; inputs remove_ids: list
# ---------- python_9: Python ----------
remove_index = []
for remove_id in remove_ids:
    member_number = int(remove_id.split('_')[0])
    member_piece = int(remove_id.split('_')[2])
    
    remove_index.append(member_number*2 + (member_piece-1))
    
print remove_index
# ---------- end python_9 ----------
panel_14 = Panel(python_9)

element_5 = ElementKaramba3D(split_2.ListA)
load_4 = LoadKaramba3D(split.ListA)

panel_15 = Panel("""38
34
37
33
36
35
39,40,41,42,43,44""")
panel_16 = Panel("""30
30
31
31
31
31
31
999""")
python_10 = GhPythonScript(n=Slider(5, range=-1..6), remove_eles=panel_15, support_eles=panel_16)  # -> remove_ids, support_idx; inputs n: Int32, remove_eles: list, support_eles: list of Int32
# ---------- python_10: Python ----------
remove_eles_copy = remove_eles[0:n+1]
print remove_eles_copy

remove_eles = []
for remove_ele in remove_eles_copy:
    list = remove_ele.split(',')
    for item in list:
        remove_eles.append(int(item))

print remove_eles
remove_ids = []
for num in remove_eles:
    remove_ids.append("{}_norm_1".format(num))
    remove_ids.append("{}_norm_2".format(num))

print remove_ids

# subtract 3 based on order of nodes list
# since fixed elements at start not part of list
support_idx = support_eles[n] - 3
# ---------- end python_10 ----------
panel_17 = Panel(python_10.remove_ids)
txt_8 = Text(python_10.remove_ids)
python_11 = GhPythonScript(remove_ids=txt_8)  # -> remove_index; inputs remove_ids: list; same code as python_9
panel_18 = Panel(python_11)

panel_19 = Panel("""30
30
30
24
24
24
24
31""")
panel_20 = Panel("""25
26
25
22
23
21""")
list = ValueList({"1st phase": 0, "2nd phase": 1}, selected="2nd phase")
num_9 = Number(python_10.support_idx)
num_10 = Number(python_8.support_idx)
filter = StreamFilter(Gate=list, Stream0=num_9, Stream1=num_10)

num_11 = Number(filter)
crv_12 = Curve(crv_7)
midpt_2 = CurveMiddle(Curve=crv_12)
pt_7 = Point(midpt_2)
end = EndPoints(Curve=crv_12)  # -> Start, End
item_5 = ListItem(List=end.Start, Index=num_11, Wrap=False)
item_6 = ListItem(List=end.End, Index=num_11, Wrap=False)
item_7 = ListItem(List=pt_7, Index=num_11, Wrap=False)
pt_8 = Point([item_5, item_6])
pt_9 = Point(item_7)
supp_3 = SupportKaramba3D(PosInd=pt_8, menu=[buttons(on, on, on, on, on, on)])
supp_4 = SupportKaramba3D(PosInd=pt_9, menu=[buttons(on, on, on, on, on, on)])
support_3 = SupportKaramba3D(supp_3)
support_4 = SupportKaramba3D(supp_4)

entwine_2 = Entwine(Branch00=support_3, Branch01=support_4, Branch02=support, Branch03=support_2, FlattenInputs=True)  # -> flatten(Result)

# ----
# SUPPORTS
# treat initial support as fixed, while the other end is pinned. This is closer to how the actual structure behaves based on the types of supports used. Could potentially add some moment support at end...
# 
# The robot grips the middle of the member as a fixed support
support_5 = SupportKaramba3D(flatten(entwine_2))

lng_3 = ListLength(List=support_5)
subtraction_3 = Subtraction(A=lng_3, B="1")
split_3 = SplitList(List=support_5, Index=subtraction_3)  # -> ListA, ListB
support_6 = SupportKaramba3D(split_3.ListA)

merge_2 = Merge(
    Data1=ColourSwatch(SwatchColor=RGB(251, 255, 0)),
    Data2=ColourSwatch(SwatchColor=RGB(255, 255, 255)),
    Data3=ColourSwatch(SwatchColor=RGB(255, 255, 255)),
    Data4=ColourSwatch(SwatchColor=RGB(255, 255, 255)),
    Data5=ColourSwatch(SwatchColor=RGB(227, 0, 0)),
    Data6=ColourSwatch(SwatchColor=RGB(21, 255, 0)))
col = Colour(merge_2)  # disabled

txt_9 = Text(txt_2)
dispatch = Dispatch(List=txt_9, DispatchPattern=[True, False])  # -> ListA, ListB
panel_21 = Panel(dispatch.ListA)
panel_22 = Panel(dispatch.ListB)
txt_10 = Text(graft(dispatch.ListB))
beam_joints = BeamJointsKaramba3D(
    ElementIdentifiers=txt_10,
    CtKNMAtStartingNode=Vector(0, 0, 0),
    CrKNmRadAtStartingNode=Vector(0, 0, 0),
    CtKNMAtEndNode=Vector(0, 0, 0),
    CrKNmRadAtEndNode="{999999,0.1,0}",
    menu=[buttons(off, off, off, off, off, off), buttons(off, off, off, off, on, on)])
joint = JointKaramba3D(beam_joints)

# ----
# JOINTS
# pin all the ends of the members, but leave the middle node (where the robot grips) as a full connection to represent the fact that the member is continuous here. Leave torsional resistance at the joints to represent the fact that the tabs will not allow members to twist about their own axis.
# 
# Do not but a joint at the ends of the support members, since they are connected to the base. Currently a torsional rigid body mode exists when but supports are assigned a joint at one end, doesn't affect results but for now keep top of start support elements without a joint
txt_11 = Text(txt)
txt_12 = Text(txt_3)
dispatch_2 = Dispatch(List=txt_11, DispatchPattern=[True, False])  # -> ListA, ListB; disabled
dispatch_3 = Dispatch(List=txt_12, DispatchPattern=[True, False])  # -> ListA, ListB
merge_3 = Merge(Data1=dispatch_2.ListA, Data2=dispatch.ListA, Data3=dispatch_3.ListA)

txt_13 = Text(graft(merge_3))
beam_joints_2 = BeamJointsKaramba3D(
    ElementIdentifiers=txt_13,
    CtKNMAtStartingNode=Vector(0, 0, 0),
    CrKNmRadAtStartingNode="{999999,0.1,0}",
    CtKNMAtEndNode=Vector(0, 0, 0),
    CrKNmRadAtEndNode=Vector(0, 0, 0),
    menu=[buttons(off, off, off, off, on, on), buttons(off, off, off, off, off, off)])
joint_2 = JointKaramba3D(beam_joints_2)

merge_4 = Merge(Data1=graft(joint_2), Data2=graft(joint))  # -> flatten(Result)

joint_3 = JointKaramba3D(merge_4)

lng_4 = ListLength(List=joint_3)
subtraction_4 = Subtraction(A=lng_4, B="21")
split_4 = SplitList(List=joint_3, Index=subtraction_4)  # -> ListA, ListB
joint_4 = JointKaramba3D(split_4.ListA)

element_6 = ElementKaramba3D(flatten(element_5))
support_7 = SupportKaramba3D(flatten(support_6))
load_5 = LoadKaramba3D(flatten(load_4))
joint_5 = JointKaramba3D(flatten(joint_4))
assemble = AssembleModelKaramba3D(Elem=flatten(element_6), Support=flatten(support_7), Load=flatten(load_5), Joint=flatten(joint_5), LimitDistance_m=0.005)  # -> Model, Info, Mass_kg, CenterOfGravity

element_7 = ElementKaramba3D(flatten(element_4))
support_8 = SupportKaramba3D(flatten(support_5))
load_6 = LoadKaramba3D(flatten(load_3))
joint_6 = JointKaramba3D(flatten(joint_3))
assemble_2 = AssembleModelKaramba3D(Elem=flatten(element_7), Support=flatten(support_8), Load=flatten(load_6), Joint=flatten(joint_6), LimitDistance_m=0.005)  # -> Model, Info, Mass_kg, CenterOfGravity

analyze = AnalyzeKaramba3D(Model=assemble.Model)  # -> CalculatedModel, MaximumDisplacement_cm, ResultingForceOfGravity_kN, ElasticEnergy_kNm
model = ModelKaramba3D(analyze.CalculatedModel)
num_12 = Number(analyze.MaximumDisplacement_cm)
num_13 = Number(analyze.ElasticEnergy_kNm)

line = Line(crv_9)
line_2 = Line(crv_10)
line_3 = Line(crv_11)
entwine_3 = Entwine(Branch00=line, Branch01=line_2, Branch02=line_3, FlattenInputs=True)  # -> flatten(Result)
crv_13 = Curve(entwine_3)
num_14 = Number(python_9)
python_12 = GhPythonScript(x=crv_13, off_idx=num_14)  # -> out, on_list; inputs x: list, off_idx: list of Int32
# ---------- python_12: Python ----------
num = len(x)

on_list = []
for i in range(num):
    on_list.append(True)
    
for idx in off_idx:
    on_list[idx] = False
    
print on_list
# ---------- end python_12 ----------
model_2 = ModelKaramba3D(model)
activate = ElementActivationKaramba3D(Model=model_2, IsActive=python_12.on_list)

analyze_2 = AnalyzeKaramba3D(Model=activate)  # -> CalculatedModel, MaximumDisplacement_cm, ResultingForceOfGravity_kN, ElasticEnergy_kNm
model_3 = ModelKaramba3D(analyze_2.CalculatedModel)
num_15 = Number(analyze_2.MaximumDisplacement_cm)
num_16 = Number(analyze_2.ElasticEnergy_kNm)

model_4 = ModelKaramba3D(model_3)

analyze_3 = AnalyzeKaramba3D(Model=assemble_2.Model)  # -> CalculatedModel, MaximumDisplacement_cm, ResultingForceOfGravity_kN, ElasticEnergy_kNm
num_17 = Number(analyze_3.ElasticEnergy_kNm)
model_5 = ModelKaramba3D(analyze_3.CalculatedModel)
num_18 = Number(analyze_3.MaximumDisplacement_cm)

line_4 = Line(crv_9)
line_5 = Line(crv_10)
line_6 = Line(crv_11)
entwine_4 = Entwine(Branch00=line_4, Branch01=line_5, Branch02=line_6, FlattenInputs=True)  # -> flatten(Result)
crv_14 = Curve(entwine_4)
num_19 = Number(python_11)
python_13 = GhPythonScript(x=crv_14, off_idx=num_19)  # -> out, on_list; inputs x: list, off_idx: list of Int32; same code as python_12
model_6 = ModelKaramba3D(model_5)
activate_2 = ElementActivationKaramba3D(Model=model_6, IsActive=python_13.on_list)

analyze_4 = AnalyzeKaramba3D(Model=activate_2)  # -> CalculatedModel, MaximumDisplacement_cm, ResultingForceOfGravity_kN, ElasticEnergy_kNm
model_7 = ModelKaramba3D(analyze_4.CalculatedModel)
num_20 = Number(analyze_4.MaximumDisplacement_cm)
num_21 = Number(analyze_4.ElasticEnergy_kNm)

model_8 = ModelKaramba3D(model_7)
filter_2 = StreamFilter(Gate=list, Stream0=model_8, Stream1=model_4)
deflection_cm = Panel(num_15)
internal_energy = Panel(num_16)
deflection_cm_2 = Panel(num_12)
internal_energy_2 = Panel(num_13)

deflection_cm_3 = Panel(num_18)
deflection_cm_4 = Panel(num_20)
internal_energy_3 = Panel(num_17)
internal_energy_4 = Panel(num_21)

model_9 = ModelKaramba3D(filter_2)
model_10 = ModelKaramba3D(model_9)
model_11 = ModelKaramba3D(model_9)
model_12 = ModelKaramba3D(model_9)
model_13 = ModelKaramba3D(model_9)
model_14 = ModelKaramba3D(model_9)
beamdisp = BeamDisplacementsKaramba3D(AnalyzedModel=model_11, LoadCase=-1, MaximumDistanceBetweenResults_m=-1, NumberOfResultsPerElement=2)  # -> AnalyzedModel, Translations_m, Rotations_rad
utilization = UtilizationOfElementsKaramba3D(
    AnalyzedModel=model_12,
    ResultCase=-1,
    NumberOfSamplePoints=3,
    ElasticDesign=True,
    GammaM0=1,
    GammaM1=1,
    WithDetails=False,
    mode="Beams")  # -> AnalyzedModel, Utilization, SigMax_kN_cm2, SigMin_kN_cm2, TauMax_kN_cm2, UtilN, UtilVy, UtilVz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
nodedisp = NodalDisplacementsKaramba3D(AnalyzedModel=model_13, ResultCase=0)  # -> AnalyzedModel, NodalTranslations_m, NodalRotations_rad
d_energy = DeformationEnergyKaramba3D(AnalyzedModel=model_14, ElementIdentifiers="32_norm_2", ResultCase=0)  # -> AnalyzedModel, flatten(AxialDeformationEnergies_kNm), BendingEnergies_kNm
modelview = ModelViewKaramba3D(Model=model_10, ResultFactors="1000", ResultCase=-1, Colors=col)  # -> Model, DeformedMesh, DeformedAxes, DeformedModel
panel_23 = Panel(d_energy.BendingEnergies_kNm)
panel_24 = Panel(d_energy.AxialDeformationEnergies_kNm)
beamview = BeamViewKaramba3D(Model=modelview.Model)  # -> Model, MeshesOfRenderedBeams, DeformedBeamAxes, LegendColors, LegendTags
panel_25 = Panel(nodedisp.NodalTranslations_m)
# SEND ROBOT COMMANDS
legend = Legend(Colour=beamview.LegendColors, Tags=beamview.LegendTags, LegendType=101)
panel_26 = Panel(beamdisp.Translations_m)

number_slider_2 = Slider(1, range=0..10)  # disabled
ladeform = LargeDeformationAnalysisKaramba3D(Model=activate_2, Increments=5, MaximumDisplacement_m=-1)  # -> CalculatedModel, MaximumDisplacement_cm; disabled
emodes = EigenModesKaramba3D(Model=activate_2, FromIndex=number_slider_2, NumberOfModes=1, MaximumNumberOfIterations=300, Epsilon=1e-07)  # -> ModelWithEigenModesAsLoadCaseResults, Eigenvalues; disabled
analyzenonlin_wip = AnalyzeNonlinearWIPKaramba3D(
    Model=activate_2,
    NumberOfLoadSteps=1,
    InitialLoadFactor=0.2,
    MaxNumberOfEquilibriumIterations=50,
    TargetNumberOfEquilibriumIterations=10,
    EquilibriumTolerance=1e-07,
    MaxNumberOfLoadIncrements=30,
    mode="ArcLength")  # -> CalculatedModel, MaximumDisplacement_cm, ElasticEnergy_kNm, Info, Lambdas; disabled

element_8 = ElementKaramba3D(flatten(element_7))
disassemble = DisassembleElementKaramba3D(Element=element_8)  # -> Element, ElementIdentifier, AxisOfElement, CrossSection, Joints, Material, LocalCoordinateSystem, ElementIsActive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
txt_14 = Text(disassemble.ElementIdentifier)
txt_15 = Text(txt_14)

model_15 = ModelKaramba3D(model_5)
b_res_force = BeamResultantForcesKaramba3D(AnalyzedModel=model_15, LoadCase=-1, MaximumProbingDistance_m=-1, NumberOfProbingPointsPerElement=3)  # -> AnalyzedModel, NormalForce_kN, ResultantBendingMoment_kNm, ResultantShearForce_kN
txt_16 = Text(txt_14)
num_22 = Number(b_res_force.NormalForce_kN)
python_14 = GhPythonScript(forces=num_22, ids=txt_16)  # -> member_forces, sorted_forces; inputs forces: list, ids: list
# ---------- python_14: Python ----------
import operator

member_forces = {}
for f,id in zip(forces,ids):
    member_forces[id] = f

sorted_forces = sorted(member_forces.items(), key=lambda k:abs(k[1]))

print member_forces["3_norm_1"]
print member_forces["3_norm_2"]
print member_forces
print sorted_forces

member_forces = [member_forces]
# ---------- end python_14 ----------
panel_27 = Panel(python_14.sorted_forces)

model_16 = ModelKaramba3D(model_7)
b_res_force_2 = BeamResultantForcesKaramba3D(AnalyzedModel=model_16, LoadCase=-1, MaximumProbingDistance_m=-1, NumberOfProbingPointsPerElement=3)  # -> AnalyzedModel, NormalForce_kN, ResultantBendingMoment_kNm, ResultantShearForce_kN
num_23 = Number(b_res_force_2.NormalForce_kN)
txt_17 = Text(txt_14)
python_15 = GhPythonScript(forces=num_23, ids=txt_17)  # -> member_forces, sorted_forces; inputs forces: list, ids: list
# ---------- python_15: Python ----------
import operator

member_forces = {}
for f,id in zip(forces,ids):
    member_forces[id] = f

sorted_forces = sorted(member_forces.items(), key=lambda k:abs(k[1]))

print sorted_forces
member_forces = [member_forces]
# ---------- end python_15 ----------
python_16 = GhPythonScript(sorted_forces=python_15.sorted_forces, amount="6")  # -> out, min_value, min_name; inputs sorted_forces: list, amount: Int32
# ---------- python_16: Python ----------
min_value = []
min_name = []

for i in range(amount):
    min_name.append(sorted_forces[i][0])
    min_value.append(sorted_forces[i][1])

print min_value
print min_name
# ---------- end python_16 ----------
python_17 = GhPythonScript(min_name=python_16.min_name)  # -> out, min_index; inputs min_name: list
# ---------- python_17: Python ----------
min_index = []

print min_name

for name in min_name:
    min_index.append( int(name.split('_')[0]))

print min_index
# ---------- end python_17 ----------
panel_28 = Panel(python_16.min_name)
num_24 = Number(python_17.min_index)
panel_29 = Panel(python_16.min_value)
panel_30 = Panel(num_24)

python_18 = GhPythonScript(x=python_14.member_forces, y=python_15.member_forces, ids=txt_15)  # -> sorted_change; inputs x: list, y: list, ids: list
# ---------- python_18: Python ----------
before = x[0]
after = y[0]

change = {}
for id in ids:
    diff = 100*(before[id] - after[id])/before[id]
    change[id] = diff
    


sorted_change= sorted(change.items(), key=lambda k:k[1])

print sorted_change
# ---------- end python_18 ----------

panel_31 = Panel(python_18)
panel_32 = Panel(python_15.sorted_forces)
