# Grasshopper definition ACADIA_network.gh (Grasshopper 1.0.7)
# plug-ins: Human

# INPUT GEOMETRY
crv = Curve([<curve referenced from the Rhino model> x45])

# ---- group: members
number_slider = Slider(44, range=0..44)
python = GhPythonScript(n=number_slider)  # -> rob_num; inputs n: Int32
# ---------- python: Python ----------
#Robot Order

order = [
2, #0
1, #1
2, #2
1, #3
2, #4
1, #5
2, #6
1, #7
2, #8
2, #9
1, #10
2, #11
2, #12
1, #13
2, #14
2, #15
1, #16
1, #17
2, #18
1, #19
2, #20
1, #21
2, #22
2, #23
2, #24
1, #25
2, #26
1, #27
2, #29
2, #28
1, #30
2, #31
1, #32
1, #33
1, #34
2, #33
2, #38
1, #36
1, #37
#done
2, #36
2, #37
2, #39
2, #41
2, #42
1, #43
]

rob_num = order[n]
# ---------- end python ----------
python_2 = GhPythonScript(n=number_slider)  # -> idx; inputs n: Int32
# ---------- python_2: Python ----------
idx = range(n+1)

print idx
# ---------- end python_2 ----------
panel = Panel(number_slider)
panel_2 = Panel(python)
data = Data(crv)
data_2 = Data(python_2)

# ---- group: nodes
pt = Point([<point referenced from the Rhino model> x17])
python_3 = GhPythonScript(n=number_slider)  # -> idx; inputs n: Int32
# ---------- python_3: Python ----------
sphere_order = {
0: 2,
1: 3,
2: 4,
3: 4,
4: 4,
5: 4,
6: 5,
7: 5,
8: 5,
9: 6,
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}

idx = range(sphere_order[n])

print idx
# ---------- end python_3 ----------
data_3 = Data(pt)
data_4 = Data(python_3)

# ---- group: cross-section
# 1 3/16" (30.16mm) section.
# this dist is to corner
panel_3 = Panel("0.0333375")
division = Division(A=panel_3, B="sqrt(2)")
polygon = Polygon(Plane=PlaneXY(0, 0, 0), Radius=division, Segments="4", FilletRadius=0)  # -> Polygon, Length
rotate = Rotate(Geometry=polygon.Polygon, Angle=degrees("45"), Plane=PlaneXY(0, 0, 0))  # -> Geometry, Transform
crv_2 = Curve(rotate.Geometry)

# ----
xz = XZPlane(Origin=Point(0, 0, 0))

# ---- group: current member curves
data_5 = Data(data_2)
data_6 = Data(data)
item = ListItem(List=data_6, Index=data_5, Wrap=True)
crv_3 = Curve(item)

# ----
crv_4 = Curve(crv_3)
project = Project(Geometry=crv_4, Plane=xz)  # -> Geometry, Transform
crv_5 = Curve(crv_4)

# ---- group: nodes
data_7 = Data(data_3)
data_8 = Data(data_4)
item_2 = ListItem(List=data_7, Index=data_8, Wrap=True)
sph = Sphere(Base=item_2, Radius="0.0333375")

# ----
pt_2 = Point(item_2)
project_2 = Project(Geometry=pt_2, Plane=xz)  # -> Geometry, Transform
pt_3 = Point(pt_2)
python_4 = GhPythonScript(reset=Toggle(True), nodes=pt_3)  # -> out, network, gkey_node; inputs nodes: list of Point3d
# ---------- python_4: Python ----------
from copy import deepcopy

from compas_rhino.geometry import RhinoPoint

from compas.utilities import geometric_key
from compas.geometry import KDTree

from compas.datastructures import Network

if reset:
    network = Network()

# print values
print("=== Network created ===")
print("number of edges: {}".format(network.number_of_edges()))
print("number of nodes: {}".format(network.number_of_nodes()))


for i,node in enumerate(nodes):
    p = RhinoPoint.from_geometry(node).to_compas()
    x, y, z = p
    # can add another attribute e.g. type="is_anchor"
    network.add_node(x=x, y=y, z=z)
    
#print network
    
network2 = deepcopy(network)
node_xyz = {node: network2.node_coordinates(node) for node in network2.nodes()}
#gkey_node = {geometric_key(xyz): node for node, xyz in node_xyz.items()}
gkey_node = network2.gkey_node()
search_tree = KDTree(node_xyz.values())

gkey_node = [gkey_node]

## produce same
#print network.key_gkey()
#print network.node_gkey()
#
#print network.gkey_key()
#print network.gkey_node()

print gkey_node
# ---------- end python_4 ----------
python_5 = GhPythonScript(network=python_4.network, n=Slider(0, range=0..45), edges=crv_5, gkey_node=python_4.gkey_node)  # -> out, network; inputs edges: list of Line, gkey_node: list
# ---------- python_5: Python ----------
from compas.datastructures import Network
from compas_rhino.geometry import RhinoLine

gkey_node = gkey_node[0]

def gen_gkey(pnt):
    return "{:.3f},{:.3f},{:.3f}".format(round(pnt.x,3), round(pnt.y,3), round(pnt.z,3))

for i,edge in enumerate(edges):
    e = RhinoLine.from_geometry(edge).to_compas()
    u = gkey_node[gen_gkey(e.start)]
    v = gkey_node[gen_gkey(e.end)]
    network.add_edge(u,v,type="member", number = "{}".format(i))
    
#    if i == n:
#        network.add_edge(u,v,type="support_option",number = "{}".format(i))

#print network
print network.edges_attribute("number")

for edge in network.edges():
    edge_number = network.edge_attribute(key=edge, name="number")
    print edge_number, edge
# ---------- end python_5 ----------
python_6 = GhPythonScript(network=python_5.network)  # -> out, max_members, min_members, network
# ---------- python_6: Python ----------
import operator
import collections

#dictionary, node: # of connecting members
def make_adj_cnt():
    dict = {}
    for n in range(network.number_of_nodes()): 
        dict[n] = len(network.data['data']['adjacency']['{}'.format(n)])
    return dict

#dictionary, sum of connectivity of the two nodes defining each member
def make_adj_cnt_member(adj_cnt):
    dict = {}
    for i,edge in enumerate(network.edges()):
        u,v = edge
        dict[i] = adj_cnt[u] + adj_cnt[v]
    return dict

#get a list of members with max connectivity
def get_members_with_max(memb_list):
    max_cnt = memb_list[0][1]
    max_list = []
    
    for memb in memb_list:
        print memb
        if memb[1] >= max_cnt:
            max_list.append(memb[0])
        else: #can break because in max order
            break
        
    return max_list
    
#get a list of members with min connectivity
def get_members_with_min(memb_list):
    min_cnt = memb_list[-1][1] + 1
    min_list = []
    
    for memb in memb_list:
        if memb[1] <= min_cnt:
            min_list.append(memb[0])
        
    return min_list
    
adj_cnt = make_adj_cnt()
adj_cnt_member = make_adj_cnt_member(adj_cnt)

sorted_adj_cnt_member = sorted(adj_cnt_member.items(), key=operator.itemgetter(1))
sorted_adj_cnt_member.reverse()

print sorted_adj_cnt_member

#members with max supports
max_members = get_members_with_max(sorted_adj_cnt_member)
min_members = get_members_with_min(sorted_adj_cnt_member)

print max_members, min_members

for edge in network.edges():
    edge_number = network.edge_attribute(key=edge, name="number")
    
    if int(edge_number) in max_members:
        network.edge_attribute(key=edge, name="type", value = "support_option")

    if int(edge_number) in min_members:
        network.edge_attribute(key=edge, name="type", value = "remove_option")

#print network
# ---------- end python_6 ----------
python_7 = GhPythonScript(network=python_6.network)  # -> out, brick_edges, glue_edges, glue2_edges
# ---------- python_7: Python ----------
from compas_ghpython.artists import NetworkArtist


bricks = []
glue = []
glue2 = []

for edge in network.edges():
    edge_type = network.edge_attribute(key=edge, name="type")
    print edge_type
    if edge_type == "member":
        bricks.append(edge)
    elif edge_type == "support_option":
        glue.append(edge)
    elif edge_type == "remove_option":
        glue2.append(edge)


for node in network.nodes():
    xyz = network.node_attributes(node, "xyz")
    #print(xyz)

artist = NetworkArtist(network)
brick_edges = artist.draw_edges(bricks)
glue_edges = artist.draw_edges(glue)
glue2_edges = artist.draw_edges(glue2)
# ---------- end python_7 ----------
crv_6 = Curve(python_7.glue2_edges)

crv_7 = Curve(python_7.glue_edges)
crv_8 = Curve(python_7.brick_edges)
entwine = Entwine(Branch00=crv_8, Branch01=crv_7, Branch02=crv_6, FlattenInputs=True)
entwine_2 = Entwine(
    Branch00=ColourSwatch(SwatchColor=RGB(0, 0, 0)),
    Branch01=ColourSwatch(SwatchColor=RGB(202, 87, 255)),
    Branch02=ColourSwatch(SwatchColor=RGB(0, 255, 119)),
    FlattenInputs=True)
entwine_3 = Entwine(Branch00="5", Branch01="5", Branch02="5", FlattenInputs=True)
previewlw = CustomPreviewLineweights(Geometry=entwine, Shader=entwine_2, Thickness=entwine_3, Absolute=False)

panel_4 = Panel(python_6.out)
